# Grasshopper definition PLAN.gh (Grasshopper 1.0.8)

# ---- group: grid distances
number_slider = Slider(8.4, range=0..10)

# ----
point = Point(Point(0, 0, 0))
multiplication = Multiplication(A=number_slider, B=Slider(2.5, range=0..10))
multiplication_2 = Multiplication(A=number_slider, B=Slider(2, range=0..10))

# ---- group: open working space
rectangle = Rectangle(Plane=point, XSize=multiplication, YSize=multiplication_2, Radius=0)  # -> Rectangle, Length
curve = Curve(rectangle.Rectangle)

# ----
number_slider_2 = Slider(1, range=0..10)
number_slider_3 = Slider(2, range=0..10)
multiplication_3 = Multiplication(A=number_slider, B=Slider(0.5, range=0..10))
surface = Surface(rectangle.Rectangle)

# ---- group: doors
curve_2 = Curve([<curve referenced from the Rhino model> x21])
surface_2 = Surface(curve_2)
mesh_brep = MeshBrep(
    Brep=surface_2,
    Settings={GridMaxCount=0, GridMinCount=16, JaggedSeams=False, MaxEdgeLength=0, MinEdgeLength=0.0001, MinTolerance=0, Refine=True, RefineAngle=0, RelativeTolerance=0.65, SimplePlanes=True, Tolerance=0})

# ---- group: windows
curve_3 = Curve([<curve referenced from the Rhino model> x14])
surface_3 = Surface(curve_3)
mesh_brep_2 = MeshBrep(
    Brep=surface_3,
    Settings={GridMaxCount=0, GridMinCount=16, JaggedSeams=False, MaxEdgeLength=0, MinEdgeLength=0.0001, MinTolerance=0, Refine=True, RefineAngle=0, RelativeTolerance=0.65, SimplePlanes=True, Tolerance=0})

# ----
explode = Explode(Curve=rectangle.Rectangle, Recursive=True)  # -> Segments, Vertices
negative = Negative(Value=multiplication_3)
multiplication_4 = Multiplication(A=number_slider_2, B=Slider(1.5, range=0..10))
unit_y = UnitY(Factor=negative)
construct_domain = ConstructDomain(DomainStart=0, DomainEnd=negative)
multiplication_5 = Multiplication(A=number_slider, B=number_slider_2)
multiplication_6 = Multiplication(A=number_slider, B=multiplication_4)
list_item = ListItem(List=explode.Vertices, Index=expr("x+1", number_slider_3), Wrap=True)
list_item_2 = ListItem(List=explode.Vertices, Index=expr("x+1", number_slider_3), Wrap=True)
list_item_3 = ListItem(List=explode.Vertices, Index=number_slider_3, Wrap=True)
negative_2 = Negative(Value=multiplication_5)
negative_3 = Negative(Value=multiplication_6)
deconstruct_domain = DeconstructDomain(Domain=construct_domain)  # -> Start, End

# ---- group: directors room
rectangle_2 = Rectangle(Plane=list_item_3, XSize=multiplication_3, YSize=construct_domain, Radius=0)  # -> Rectangle, Length
move = Move(Geometry=rectangle_2.Rectangle, Motion=unit_y)  # -> Geometry, Transform
curve_4 = Curve(rectangle_2.Rectangle)
curve_5 = Curve(move.Geometry)

# ---- group: service + support
rectangle_3 = Rectangle(Plane=list_item, XSize=negative_2, YSize=negative_2, Radius=0)  # -> Rectangle, Length
curve_6 = Curve(rectangle_3.Rectangle)
curve_7 = Curve(curve_6)

# ----
rectangle_4 = Rectangle(Plane=list_item_2, XSize=negative_3, YSize=negative_3, Radius=0)  # -> Rectangle, Length
multiplication_7 = Multiplication(A=deconstruct_domain.End, B=Slider(2, range=0..10))
solid_difference = SolidDifference(BrepsA=rectangle_4.Rectangle, BrepsB=rectangle_3.Rectangle)
construct_domain_2 = ConstructDomain(DomainStart=deconstruct_domain.Start, DomainEnd=multiplication_7)
explode_2 = Explode(Curve=move.Geometry, Recursive=True)  # -> Segments, Vertices
deconstruct_brep = DeconstructBrep(Brep=solid_difference)  # -> Faces, Edges, Vertices
list_item_4 = ListItem(List=explode_2.Vertices, Index=0, Wrap=True)

# ---- group: public
curve_8 = Curve(deconstruct_brep.Faces)
curve_9 = Curve(curve_8)

# ----
explode_3 = Explode(Curve=curve_8, Recursive=True)  # -> Segments, Vertices

# ---- group: meeting room
rectangle_5 = Rectangle(Plane=list_item_4, XSize=multiplication_3, YSize=construct_domain_2, Radius=0)  # -> Rectangle, Length
curve_10 = Curve(rectangle_5.Rectangle)

# ----
list_item_5 = ListItem(List=explode_3.Segments, Index=0, Wrap=True)
list_item_6 = ListItem(List=explode_3.Vertices, Index=-2, Wrap=True)
merge = Merge(Data1=rectangle.Rectangle, Data2=rectangle_2.Rectangle, Data3=move.Geometry, Data4=rectangle_5.Rectangle)
length = Length(Curve=list_item_5)
solid_union = SolidUnion(Breps=flatten(merge))
point_2 = Point(list_item_6)
negative_4 = Negative(Value=length)
unit_x = UnitX(Factor=negative_4)

# ---- group: reception
rectangle_6 = Rectangle(Plane=list_item_6, XSize=multiplication_5, YSize=negative_4, Radius=0)  # -> Rectangle, Length
curve_11 = Curve(rectangle_6.Rectangle)

# ---- group: meeting room
rectangle_7 = Rectangle(Plane=list_item_6, XSize=negative_4, YSize=multiplication_5, Radius=0)  # -> Rectangle, Length
curve_12 = Curve(rectangle_7.Rectangle)

# ---- group: waiitng lounge
rectangle_8 = Rectangle(Plane=list_item_6, XSize=negative_4, YSize=negative_4, Radius=0)  # -> Rectangle, Length
curve_13 = Curve(rectangle_8.Rectangle)

# ----
move_2 = Move(Geometry=point_2, Motion=unit_x)  # -> Geometry, Transform
negative_5 = Negative(Value=negative_4)
addition = Addition(A=multiplication_5, B=negative_5)

# ---- group: private-workers
curve_14 = Curve(solid_union)

# ----
surface_4 = Surface(curve_9)
surface_5 = Surface(curve_14)
surface_6 = Surface(curve_6)
custom_preview = CustomPreview(
    Geometry=surface_5,
    Material={diffuse=RGB(170, 255, 0), emission=RGB(51, 76, 0), shine=0.5, specular=RGB(255, 255, 255), transparency=0})
custom_preview_2 = CustomPreview(
    Geometry=surface_6,
    Material={diffuse=RGB(115, 75, 156), emission=RGB(34, 22, 47), shine=0.5, specular=RGB(255, 255, 255), transparency=0})
custom_preview_3 = CustomPreview(
    Geometry=surface_4,
    Material={diffuse=RGB(181, 100, 159), emission=RGB(54, 30, 48), shine=0.5, specular=RGB(255, 255, 255), transparency=0})
number_slider_4 = Slider(3, range=0..10)
curve_15 = Curve(curve_6)
explode_4 = Explode(Curve=curve_15, Recursive=True)  # -> Segments, Vertices
number_slider_5 = Slider(1.4, range=0..10)
list_item_7 = ListItem(List=explode_4.Vertices, Index=number_slider_4, Wrap=True)
multiplication_8 = Multiplication(A=number_slider_5, B=Slider(3, range=0..10))
unit_x_2 = UnitX(Factor=number_slider_5)
construct_domain_3 = ConstructDomain(DomainStart=0, DomainEnd=multiplication_8)
move_3 = Move(Geometry=list_item_7, Motion=unit_x_2)  # -> Geometry, Transform
negative_6 = Negative(Value=construct_domain_3)
number_slider_6 = Slider(1.8, range=0..10)
unit_x_3 = UnitX(Factor=number_slider_6)
list_item_8 = ListItem(List=explode_4.Vertices, Index=expr("x-1", number_slider_4), Wrap=True)
negative_7 = Negative(Value=number_slider_6)
colour_swatch = ColourSwatch(SwatchColor=RGB(222, 82, 124))
colour_swatch_2 = ColourSwatch(SwatchColor=RGB(42, 57, 191))
colour_swatch_3 = ColourSwatch(SwatchColor=RGB(122, 121, 118))
colour_swatch_4 = ColourSwatch(SwatchColor=RGB(135, 255, 135))
colour_swatch_5 = ColourSwatch(SwatchColor=RGB(97, 150, 92))
surface_7 = Surface(curve_4)
surface_8 = Surface(curve)
surface_9 = Surface(curve_5)
surface_10 = Surface(curve_10)
surface_11 = Surface(curve_12)
surface_12 = Surface(curve_13)
surface_13 = Surface(curve_11)
custom_preview_4 = CustomPreview(
    Geometry=surface_11,
    Material={diffuse=RGB(54, 255, 54), emission=RGB(16, 76, 16), shine=0.5, specular=RGB(255, 255, 255), transparency=0})
custom_preview_5 = CustomPreview(
    Geometry=surface_12,
    Material={diffuse=RGB(181, 87, 83), emission=RGB(54, 26, 25), shine=0.5, specular=RGB(255, 255, 255), transparency=0})
custom_preview_6 = CustomPreview(Geometry=surface_13, Material=ColourSwatch(SwatchColor=RGB(135, 255, 249)))
custom_preview_7 = CustomPreview(
    Geometry=surface_8,
    Material={diffuse=RGB(88, 237, 195), emission=RGB(26, 71, 58), shine=0.5, specular=RGB(255, 255, 255), transparency=0})
custom_preview_8 = CustomPreview(
    Geometry=[surface_7, surface_9],
    Material={diffuse=RGB(237, 229, 83), emission=RGB(71, 69, 25), shine=0.5, specular=RGB(255, 255, 255), transparency=0})
custom_preview_9 = CustomPreview(
    Geometry=surface_10,
    Material={diffuse=RGB(237, 165, 161), emission=RGB(71, 50, 48), shine=0.5, specular=RGB(255, 255, 255), transparency=0})
merge_2 = Merge(Data1=curve_11, Data2=curve_13)

# ----
# RECEP+LOUNGE
rectangle_9 = Rectangle(Plane=move_2.Geometry, XSize=addition, YSize=negative_4, Radius=0)  # -> Rectangle, Length
surface_14 = Surface(rectangle_9.Rectangle)

merge_3 = Merge(Data1=surface_8, Data2=surface_7, Data3=surface_9, Data4=surface_10)
merge_4 = Merge(Data1=surface_13, Data2=surface_11, Data3=surface_12)
brep_join = BrepJoin(Breps=flatten(merge_3))  # -> Breps, Closed
brep_join_2 = BrepJoin(Breps=merge_4)  # -> Breps, Closed
move_4 = Move(Geometry=merge_2, Motion=Vector(0, 0, 4))  # -> Geometry, Transform
move_5 = Move(Geometry=curve_12, Motion=Vector(0, 0, 4))  # -> Geometry, Transform

# ---- group: ADMINISTRATIVE OFFICES
curve_16 = Curve(move_4.Geometry)

# ---- group: FOUNDER OFFICE
curve_17 = Curve(move_5.Geometry)

# ----
surface_15 = Surface(curve_16)
surface_16 = Surface(curve_17)
custom_preview_10 = CustomPreview(Geometry=surface_16, Material=ColourSwatch(SwatchColor=RGB(145, 0, 0)))
custom_preview_11 = CustomPreview(
    Geometry=surface_15,
    Material={diffuse=RGB(255, 0, 0), emission=RGB(76, 0, 0), shine=0.5, specular=RGB(255, 255, 255), transparency=0})
number_slider_7 = Slider(4, range=0..10)
vector_xyz = VectorXYZ(XComponent=0, YComponent=0, ZComponent=number_slider_7)  # -> Vector, Length
vector_xyz_2 = VectorXYZ(XComponent=0, YComponent=0, ZComponent=expr("x*2", number_slider_7))  # -> Vector, Length

# ---- group: wc
rectangle_10 = Rectangle(Plane=move_3.Geometry, XSize=construct_domain_3, YSize=negative_6, Radius=0)  # -> Rectangle, Length
curve_18 = Curve(rectangle_10.Rectangle)

# ----
explode_5 = Explode(Curve=rectangle_10.Rectangle, Recursive=True)  # -> Segments, Vertices
list_item_9 = ListItem(List=explode_5.Vertices, Index=0, Wrap=True)
list_item_10 = ListItem(List=explode_5.Vertices, Index=2, Wrap=True)
move_6 = Move(Geometry=list_item_9, Motion=unit_x_3)  # -> Geometry, Transform
list_item_11 = ListItem(List=explode_5.Vertices, Index=1, Wrap=True)
line = Line(StartPoint=list_item_8, EndPoint=list_item_10)
line_2 = Line(StartPoint=list_item_11, EndPoint=move_6.Geometry)
length_2 = Length(Curve=line)
length_3 = Length(Curve=line_2)
negative_8 = Negative(Value=length_2)
surface_17 = Surface(curve_18)
custom_preview_12 = CustomPreview(Geometry=surface_17, Material=colour_swatch_2)
move_7 = Move(Geometry=curve_18, Motion=Vector(0, 0, 4))  # -> Geometry, Transform

# ---- group: wc (continued)
curve_19 = Curve(move_7.Geometry)

# ----
surface_18 = Surface(curve_19)
custom_preview_13 = CustomPreview(Geometry=surface_18, Material=colour_swatch_2)

# ---- group: tech.
rectangle_11 = Rectangle(Plane=list_item_9, XSize=number_slider_6, YSize=negative_7, Radius=0)  # -> Rectangle, Length
curve_20 = Curve(rectangle_11.Rectangle)

# ----
surface_19 = Surface(curve_20)
custom_preview_14 = CustomPreview(Geometry=surface_19, Material=colour_swatch_3)
move_8 = Move(Geometry=curve_20, Motion=Vector(0, 0, 4))  # -> Geometry, Transform

# ---- group: tech. (continued)
curve_21 = Curve(move_8.Geometry)

# ----
surface_20 = Surface(curve_21)
custom_preview_15 = CustomPreview(Geometry=surface_20, Material=colour_swatch_3)

# ---- group: elevator
rectangle_12 = Rectangle(Plane=move_6.Geometry, XSize=length_3, YSize=negative_7, Radius=0)  # -> Rectangle, Length
curve_22 = Curve(rectangle_12.Rectangle)

# ----
explode_6 = Explode(Curve=rectangle_12.Rectangle, Recursive=True)  # -> Segments, Vertices
list_item_12 = ListItem(List=explode_6.Vertices, Index=1, Wrap=True)
vector_2pt = Vector2Pt(PointA=list_item_12, PointB=list_item_8, Unitize=False)  # -> Vector, Length
deconstruct_vector = DeconstructVector(Vector=vector_2pt.Vector)  # -> XComponent, YComponent, ZComponent
number = Number(deconstruct_vector.YComponent)
negative_9 = Negative(Value=number)
surface_21 = Surface(curve_22)
custom_preview_16 = CustomPreview(Geometry=surface_21, Material=colour_swatch_4)
move_9 = Move(Geometry=curve_22, Motion=Vector(0, 0, 4))  # -> Geometry, Transform

# ---- group: elevator (continued)
curve_23 = Curve(move_9.Geometry)

# ----
surface_22 = Surface(curve_23)
custom_preview_17 = CustomPreview(Geometry=surface_22, Material=colour_swatch_4)

# ---- group: vert ciruclation
rectangle_13 = Rectangle(Plane=list_item_8, XSize=negative_8, YSize=negative_9, Radius=0)  # -> Rectangle, Length
curve_24 = Curve(rectangle_13.Rectangle)

# ----
surface_23 = Surface(curve_24)
merge_5 = Merge(Data1=surface_17, Data2=surface_19, Data3=surface_21, Data4=surface_23)  # -> flatten(Result)
brep_join_3 = BrepJoin(Breps=merge_5)  # -> Breps, Closed
solid_difference_2 = SolidDifference(BrepsA=curve_7, BrepsB=brep_join_3.Breps)
custom_preview_18 = CustomPreview(Geometry=surface_23, Material=colour_swatch_5)
move_10 = Move(Geometry=curve_24, Motion=Vector(0, 0, 4))  # -> Geometry, Transform

# ---- group: vert ciruclation (continued)
curve_25 = Curve(move_10.Geometry)

# ----
surface_24 = Surface(curve_25)
custom_preview_19 = CustomPreview(Geometry=surface_24, Material=colour_swatch_5)
merge_6 = Merge(Data1=surface_21, Data2=surface_23)  # -> flatten(Result)
extrude = Extrude(Base=merge_6, Direction=vector_xyz_2.Vector)

# ---- group: corridor
curve_26 = Curve(solid_difference_2)

# ----
surface_25 = Surface(curve_26)
custom_preview_20 = CustomPreview(Geometry=surface_25, Material=colour_swatch)
merge_7 = Merge(Data1=surface_25, Data2=surface_17, Data3=surface_19, Data4=surface_21, Data5=surface_23)
brep_join_4 = BrepJoin(Breps=flatten(merge_7))  # -> Breps, Closed
move_11 = Move(Geometry=curve_26, Motion=Vector(0, 0, 4))  # -> Geometry, Transform

# ---- group: corridor (continued)
curve_27 = Curve(move_11.Geometry)

# ----
surface_26 = Surface(curve_27)
custom_preview_21 = CustomPreview(Geometry=surface_26, Material=colour_swatch)
merge_8 = Merge(
    Data1=surface_10,
    Data2=surface_9,
    Data3=surface_7,
    Data4=surface_8,
    Data5=surface_14,
    Data6=surface_11,
    Data7=surface_25,
    Data8=surface_17,
    Data9=surface_19)  # -> flatten(Result)
merge_9 = Merge(Data1=surface_15, Data2=surface_16, Data3=surface_26, Data4=surface_18, Data5=surface_20)  # -> flatten(Result)
extrude_2 = Extrude(Base=merge_8, Direction=vector_xyz.Vector)
extrude_3 = Extrude(Base=merge_9, Direction=vector_xyz.Vector)
merge_10 = Merge(Data1=extrude_2, Data2=extrude_3, Data3=extrude)
geometry = Geometry(merge_10)
mesh_brep_3 = MeshBrep(
    Brep=geometry,
    Settings={GridMaxCount=0, GridMinCount=16, JaggedSeams=False, MaxEdgeLength=0, MinEdgeLength=0.0001, MinTolerance=0, Refine=True, RefineAngle=0, RelativeTolerance=0.65, SimplePlanes=True, Tolerance=0})
geometry_2 = Geometry(mesh_brep_3)
custom_preview_22 = CustomPreview(
    Geometry=geometry_2,
    Material={diffuse=RGB(255, 255, 255), emission=RGB(76, 76, 76), shine=0.5, specular=RGB(255, 255, 255), transparency=1})
